# Grasshopper definition Example.gh (Grasshopper 0.9.76)
# plug-ins: Leopard version 0a1

number_slider = Slider(3, range=0..10)
mesh = Mesh(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)
mesh_2 = Mesh(graft([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]))
mbox = MeshBox(
    Base={Plane=PlaneXY(0, 0, 0), X=Domain(-10, 10), Y=Domain(-10, 10), Z=Domain(-10, 10)},
    XCount=number_slider,
    YCount=number_slider,
    ZCount=number_slider)
l_dualmesh = LeopardsDualMesh(Mesh=mesh_2)
l_selfaces = LeopardsSelectMeshFaces(Mesh=mbox, lock=True, maintain=False, order=False, selectedobject="14|16|20|49")  # -> Geometry, Index
l_seledges = LeopardsSelectMeshEdges(
    Mesh=mesh_2,
    lock=True,
    maintain=False,
    order=False,
    selectedobject="6159|6153|6152|6155|6163|6173|6177|6178|6227|6235|6236|6247|6257|6308|6253|6142|6141|6146|6148|6200|6206|6210|6212|6218|6216|6202|6194|6192|6185|6223|6233|6243|22727|22146|21619|21197|20741|20208|18208|17583|16890|16136|15651|15120|14682|14120|13525|13265|13016|23185|6198|18781|19463|6166|6168|6187|6184|6180")  # -> Geometry, Index
l_selfaces_2 = LeopardsSelectMeshFaces(Mesh=mesh_2, lock=True, maintain=False, order=False, selectedobject="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")  # -> Geometry, Index
l_selvertices = LeopardsSelectMeshVertices(Mesh=mesh_2, lock=True, maintain=False, order=False, selectedobject="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")  # -> Geometry, Index
l_windowframe = LeopardsWindowFrame(
    Mesh=mbox,
    Face=l_selfaces.Index,
    ThicknessRatio=Slider(0.475, range=0..1),
    ExtrudesLength=Slider(10, range=0..10),
    Cap=True)
l_edgenb = LeopardsEdgeNeighbours(Mesh=mesh_2, Index=l_seledges.Index)  # -> ThisEdge, EdgeVertices, EdgeFaces, EdgeFacesCenter
l_verticesn = LeopardsVerticesNeighbours(Mesh=mesh_2, Vertex=l_selvertices.Index)  # -> ThisVertex, VertexNVPoints, VertexNELines, VertexNFPolyLines, VertexNFCPoints
l_facenb = LeopardsFaceNeighbours(Mesh=mesh_2, Face=l_selfaces_2.Index)  # -> ThisFace, FaceVertices, FaceNeighbourEdges, FaceNeighbourFaces
l_selfaces_3 = LeopardsSelectMeshFaces(
    Mesh=mesh,
    lock=True,
    maintain=False,
    order=False,
    selectedobject="1012|2215|2214|1011|2225|2224|2222|1020|1018|1017|2223|2173|2172|1019|974|973|2171|2170|1398|1397|1396|1395|968|967|196|195|194|193|1390|1389|1388|1387|188|187|186|185|2217|2216|1010|1009|2189|2188|990|989|2191|2190|988|987|2197|998|997|995|996|1005|1006|1003|1004|2206|2207|2204|2205|2196|2199|2198")  # -> Geometry, Index
l_seledges_2 = LeopardsSelectMeshEdges(Mesh=l_windowframe, lock=True, maintain=False, order=False, selectedobject="66|105|38")  # -> Geometry, Index
l_catmullclark = LeopardsCatmullClarkSubdivision(Mesh=l_windowframe, Level=Slider(2, range=0..10), Edges=l_seledges_2.Index, Mode=6)
l_windowframe_2 = LeopardsWindowFrame(
    Mesh=mesh,
    Face=l_selfaces_3.Index,
    ThicknessRatio=Slider(0.411, range=0..1),
    ExtrudesLength=Slider(4, range=0..10),
    Cap=False)
l_catmullclark_2 = LeopardsCatmullClarkSubdivision(Mesh=l_windowframe_2, Level=Slider(1, range=0..3), Mode=0)
l_faces = LeopardsFaces(Mesh=l_windowframe_2)  # -> FaceCenters, FaceBoundaryCurves, NakedFaces, NakedFacesIndices, ClosedFaces, ClosedFacesIndices
l_edges = LeopardsEdges(Mesh=l_windowframe_2)  # -> Edges, NakedEdges, NakedEdgesIndices, ClosedEdges, ClosedEdgesIndices
l_vertices = LeopardsVertices(Mesh=l_windowframe_2)  # -> VertexPoints, VectorNormal, VertexNakedPoints, VertexNakedPointsIndex, VertexClosedPoints, VertexClosedPointsIndex
l_verticesn_2 = LeopardsVerticesNeighbours(Mesh=l_windowframe_2, Vertex=l_vertices.VertexNakedPointsIndex)  # -> ThisVertex, VertexNVPoints, VertexNELines, VertexNFPolyLines, VertexNFCPoints
l_facenb_2 = LeopardsFaceNeighbours(Mesh=l_windowframe_2, Face=l_faces.NakedFacesIndices)  # -> ThisFace, FaceVertices, FaceNeighbourEdges, FaceNeighbourFaces
l_edgenb_2 = LeopardsEdgeNeighbours(Mesh=l_windowframe_2, Index=l_edges.NakedEdgesIndices)  # -> ThisEdge, EdgeVertices, EdgeFaces, EdgeFacesCenter
